# Grasshopper definition masterscript.gh (Grasshopper 1.0.7)
# plug-ins: Hops, MetaHopper, Wombat, Human, LayoutTools

legend = Legend(
    Colour=[RGB(246, 220, 172), RGB(237, 176, 35), RGB(229, 115, 44), RGB(224, 59, 49), RGB(37, 159, 164)],
    Tags=["'todo'", "'inprogress'", "'changerequested'", "'review'", "'done'"],
    LegendType=1)

# ----
# Master Script
panel = Panel("tasks\Massing.gh")
relpath = RelativePath(Path=panel)

panel_2 = Panel("""        'todo': '#F6DCAC'
        'inprogress': '#EDB023'
        'changerequested': '#E5732C'
        'review': '#E03B31'
        'done': '#259FA4'""")
trim = TextTrim(Text=panel_2, Start=True, End=True)
split = TextSplit(Text=trim, Separators=":")
item = ListItem(List=split, Index=0, Wrap=True)  # -> Item, Item1
rep = ReplaceText(Text=item.Item1, Find="'", Replace=" ", RecursiveReplace=False)
trim_2 = TextTrim(Text=rep, Start=True, End=True)
panel_3 = Panel(trim_2)
col = Colour(flatten(panel_3))

# ---- group: all hops / done
hops = Hops(
    _Path=relpath,
    TaskID="d41f4132-5d79-11ed-9b6a-0242ac120002",
    Radius=Slider(60, range=0..100),
    Height=Slider(300, range=0..1000),
    IntTwistAngleDegrees=Slider(180, range=0..1000),
    CacheResultsInMemory=True,
    CacheSolveResults=True,
    RemoteDefinitionLocation="C:\Users\jkamm\git\DevHops\DevHopsGhSamples\tasks\Massing.gh",
    RemoteSolveVersion=(0, 1, 0),
    ShowInput_Enabled=False,
    ShowInput_Path=True,
    SynchronousSolve=True)

# ----
preview = CustomPreview(Geometry=hops, Material=graft(ColourSwatch(SwatchColor=RGB(38, 141, 146))))  # disabled

relpath_2 = RelativePath(Path="tasks\Panelization_2.0.gh")

# ---- group: review
hops_2 = Hops(
    _Path=relpath_2,
    TaskID="df63e25a-5d79-11ed-9b6a-0242ac120002",
    IntFaceCountUPerSrf=Slider(4, range=0..10),
    BrepMass=hops,
    CacheResultsInMemory=False,
    CacheSolveResults=False,
    RemoteDefinitionLocation="C:\Users\jkamm\git\DevHops\DevHopsGhSamples\tasks\Panelization_2.0.gh",
    RemoteSolveVersion=(0, 1, 0),
    ShowInput_Enabled=False,
    ShowInput_Path=True,
    SynchronousSolve=True)

# ----
relpath_3 = RelativePath(Path="tasks\Patterning.gh")

relpath_4 = RelativePath(Path="tasks\PanelRationalize.gh")

relpath_5 = RelativePath(Path="tasks\SubStructures.gh")

# ---- group: to do
hops_3 = Hops(
    _Path=relpath_3,
    TaskID="ea4952b8-5d79-11ed-9b6a-0242ac120002",
    SrfPanelsByScope=hops_2,
    CacheResultsInMemory=True,
    CacheSolveResults=True,
    RemoteDefinitionLocation="C:\Users\jkamm\git\DevHops\DevHopsGhSamples\tasks\Patterning.gh",
    RemoteSolveVersion=(0, 1, 0),
    ShowInput_Enabled=False,
    ShowInput_Path=True,
    SynchronousSolve=True)

hops_4 = Hops(
    _Path=relpath_4,
    TaskID="ADD ID",
    SrfPanelsByScope=hops_2,
    CacheResultsInMemory=True,
    CacheSolveResults=True,
    RemoteDefinitionLocation="C:\Users\jkamm\git\DevHops\DevHopsGhSamples\tasks\PanelRationalize.gh",
    RemoteSolveVersion=(0, 1, 0),
    ShowInput_Enabled=False,
    ShowInput_Path=True,
    SynchronousSolve=True)

# ---- group: all hops / in progress
# Extract Data for Estimation
# inputs:
# Pipe Curves
# Panels
# Pattern elements: number of perforation? Surface area of paint?
# outputs:
# data stats
# Visualization
# Texture maps
hops_5 = Hops(
    _Path=relpath_5,
    TaskID="f739958c-5d79-11ed-9b6a-0242ac120002",
    SrfPanelsByScope=hops_2,
    NumPipeRadius=Slider(0.4, range=0..1),
    BrepMass=hops,
    CacheResultsInMemory=True,
    CacheSolveResults=True,
    RemoteDefinitionLocation="C:\Users\jkamm\git\DevHops\DevHopsGhSamples\tasks\SubStructures.gh",
    RemoteSolveVersion=(0, 1, 0),
    ShowInput_Enabled=False,
    ShowInput_Path=True,
    SynchronousSolve=True)  # -> CrvMullionPipes, BrepMullionPipes

# ----
G = Data(hops_5.BrepMullionPipes)
tstat = TreeStatistics(Tree=simplify(G))  # -> Paths, Length, Count; disabled
crv = Curve(G)
dpath = DeconstructPath(Branch=tstat.Paths)  # disabled
evalsrf = EvaluateSurface(Surface=reparameterize(G), Point=Point(0.5, 0.5, 0))  # -> Point, Normal, UDirection, VDirection, Frame
tstat_2 = TreeStatistics(Tree=simplify(G))  # -> Paths, Length, Count
join = TextJoin(Text=dpath)  # disabled
points = PointList(Points=evalsrf.Point)
bnd = Bounds(Numbers=flatten(join))  # disabled
randcol = RandomColor(Data=tstat_2.Paths, Seed=2, FastMode=False)
remap = RemapNumbers(Value=join, Source=bnd, Target=Domain(0, 1))  # -> Mapped, Clipped; disabled
gradient = Gradient(
    LowerLimit=0,
    UpperLimit=1,
    Parameter=remap.Mapped,
    stops=[0: RGB(243, 57, 0), 0.1: RGB(236, 27, 60), 0.2: RGB(210, 0, 118), 0.3: RGB(103, 0, 120), 0.4: RGB(39, 72, 161), 0.5: RGB(1, 192, 229), 0.6: RGB(18, 178, 90), 0.7: RGB(79, 186, 8), 0.8: RGB(220, 237, 32), 0.9: RGB(247, 159, 20)])  # disabled
preview_2 = CustomPreview(Geometry=G, Material=graft(randcol))
previewlw = CustomPreviewLineweights(Geometry=crv, Shader=ColourSwatch(SwatchColor=RGB(0, 0, 0)), Thickness=Slider(1, range=0..1), Absolute=False)  # disabled

iteratename = Button()
bake_image = Button()
bake_text = Button()
open_image_text_folder = Button()
open_test_image_folder = Button()
pystep = PythonStepper(Up=iteratename)  # -> C
# ---------- pystep: Python ----------
initVal = 0
step = 1
reset = R
up = Up
down = Dn

if not 'acc' in vars():
    acc = initVal

if reset > 0:
    acc = initVal

if up > 0:
    acc += step
if down > 0:
    acc -= step

C = acc
# ---------- end pystep ----------
format = Format(Format="{0}{1:00}{2}", Culture=127, Data0="C:\Users\jkamm\Dropbox\devhops\images\tempView", Data1=pystep, Data2=".jpg")
saveview = SaveViewportToFile(Run=bake_image, ViewportName="ScriptView", Render=False, FilePath=format, ScaleFactor=Slider(0.5, range=0..1))
img2str = SerializeImageToString(ImagePath=saveview)

panel_4 = Panel(format)

len = TextLength(Text=saveview)
subtraction = Subtraction(A=len, B="3")
fragment = TextFragment(Text=saveview, Start="0", Count=subtraction)
concat = Concatenate(FragmentA=fragment, FragmentB="txt")

file = ReadFile(File=concat, PerLineParse=True)
writetxt = WriteToTextFile(Run=bake_text, TextToWrite=img2str, FilePath=concat, Append=False, NewOnly=False)
opensesame = SafeFolderOpener(Open=open_image_text_folder, Folders=concat)
str2img = DeserializeImageFromString(ImageString=file)
opensesame_2 = SafeFolderOpener(Open=open_test_image_folder, Folders=str2img)
