# Grasshopper definition SubStructures.gh (Grasshopper 1.0.7)
# plug-ins: Sasquatch, DevHopsGH

# ---- group: Hard-Coded Input
txt_message = Panel("Don't mess with me")  # disabled

geo_input = Curve([<curve referenced from the Rhino model> x18])  # disabled

# ---- group: User Input (Optional)
type_descriptivename = Slider(0.05, range=0..0.1)  # disabled

# ---- group: User Input (Must Use)
geo_input_2 = Curve([<curve referenced from the Rhino model> x18])  # disabled

# ---- group: User Action (Must Use)
button = Button()  # disabled

# ----
# Key
# Faint Wires between Groups
txt_message_2 = Data(txt_message)  # disabled
geo_input_3 = Curve(geo_input)  # disabled

# ----
# Description of
# Group Function
geo_input_4 = Curve(geo_input_3)  # disabled
txt_message_3 = Data(txt_message_2)  # disabled
# Goal: Note for future development of code.  Express as an action to complete
move = Move(Geometry=geo_input_4, Motion=Vector(0, 0, 10))  # -> Geometry, Transform; disabled

# ---- group: Data/Geo to Check
txt_message_4 = Panel(txt_message_3)  # disabled

# ---- group: To Output
geo_input_moved = Curve(move.Geometry)  # disabled

# ----
# Code Description: Develop Substructure
# Goals:
# - Mullion lines
# - Panel Tabs?
panel = Panel("f739958c-5d79-11ed-9b6a-0242ac120002")
num_piperadius_proxy = Slider(0.4, range=0..1)
srf_panelsbyscope_proxy = Geometry(Tree({0;0}: [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], {0;1}: [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], {0;2}: [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], {0;3}: [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], {1;0}: [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], {1;1}: [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]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))
brep_mass_proxy = Geometry(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)

srf_panelsbyscope = GetGeometry(srf_panelsbyscope_proxy, AtLeast=1, AtMost=1, DeleteInput=False, Filter=3220963274, TreeAccess=True)
taskid = GetString(panel, AtLeast=0, AtMost=1, Prompt="Unique Task ID", TreeAccess=False)
brep_mass = GetGeometry(brep_mass_proxy, AtLeast=1, AtMost=1, DeleteInput=False, Filter=3220963282, TreeAccess=False)
num_piperadius = GetNumber(num_piperadius_proxy, AtLeast=0, AtMost=1, Maximum=1.797693135e+308, Minimum=-1.797693135e+308, TreeAccess=False)

srf_panelsbyscope_2 = Data(srf_panelsbyscope)
debrep = DeconstructBrep(Brep=srf_panelsbyscope_2)  # -> Faces, Edges, Vertices
item = ListItem(List=debrep.Edges, Index=0, Wrap=True)
pshift = ShiftPaths(Data=item, Offset=-1)
join = JoinCurves(Curves=pshift, Preserve=False)  # -> simplify(Curves)
pshift_2 = ShiftPaths(Data=join, Offset=-1)
crv_paneledges_vertical = Data(pshift_2)

# ----
# Remove Top And Bottom Surface
brep_inputmass = Geometry(brep_mass)
debrep_2 = DeconstructBrep(Brep=brep_inputmass)  # -> Faces, Edges, Vertices
evalsrf = EvaluateSurface(Surface=reparameterize(debrep_2.Faces), Point=Point(0.5, 0.5, 0))  # -> Point, Normal, UDirection, VDirection, Frame
pdecon = Deconstruct(Point=evalsrf.Point)  # -> XComponent, YComponent, ZComponent
sort = SortList(Keys=pdecon.ZComponent, ValuesA=debrep_2.Faces)  # -> Keys, ValuesA
panel_2 = Panel("""0
-1""")
cull_i = CullIndex(List=sort.ValuesA, Indices=panel_2, Wrap=True)
join_2 = BrepJoin(Breps=cull_i)  # -> Breps, Closed
brep_input_open = Data(join_2.Breps)

taskid_2 = Data(taskid)
devhopsgh = DevHopsGH(TaskID=taskid_2)  # -> TaskStatus, Comments

panel_3 = Panel(devhopsgh.Comments)
# Develop Substructure
panel_4 = Panel(devhopsgh.TaskStatus)

# ----
# Offset Surface for Pipe dimensions
number_slider = Slider(1.3, range=0..10)
brep_input_open_2 = Data(brep_input_open)
neg = Negative(Value=number_slider)
offsetbrep = OffsetBrep(Brep=brep_input_open_2, OffsetDistance=neg, Solid=False, SharpEdges=True, Tolerance=0.001)
debrep_3 = DeconstructBrep(Brep=offsetbrep)  # -> Faces, Edges, Vertices
srf_offsetsrfs = Data(debrep_3.Faces)
G = Data(offsetbrep)

updatestatuscomponent = UpdateStatusComponent(TaskID=taskid_2, Status="Review", Screenshot=Toggle(False), AddComment="comments addressed")  # disabled

# ----
# Get Surface Per Pipe
# cull last of each side?
crv_paneledges_vertical_2 = Data(crv_paneledges_vertical)
srf_offsetsrfs_2 = Data(srf_offsetsrfs)
midpt = CurveMiddle(Curve=crv_paneledges_vertical_2)
Z = UnitZ(Factor=1)
line = LineSDL(Start=midpt, Direction=Z, Length=1)
panel_5 = Panel("Sort Pipes")
crvnear = CurveNearestObject(Curve=line, Geometry=srf_offsetsrfs_2)  # -> PointA, PointB, Index
item_2 = ListItem(List=srf_offsetsrfs_2, Index=crvnear.Index, Wrap=True)
pull = PullCurve(Curve=crv_paneledges_vertical_2, Surface=item_2)
C = Data(pull)

G_2 = Data(G)
srf_panelsbyscope_3 = Data(G_2)
Z_2 = UnitZ(Factor=1)
debrep_4 = DeconstructBrep(Brep=srf_panelsbyscope_3)  # -> Faces, Edges, Vertices
edgesdir = EdgesFromDirections(Brep=srf_panelsbyscope_3, Directions=Z_2, Reflex=True, Angle=Slider(0.825, range=0..10))  # -> Edges, Indices, Map
item_3 = ListItem(List=debrep_4.Edges, Index=edgesdir.Indices, Wrap=True)

panel_6 = Panel(C)

merge = Merge(Data1=simplify(C), Data2=simplify(item_3))
num_piperadius_2 = Data(num_piperadius)
pipe = Pipe(Curve=merge, Radius=num_piperadius_2, Caps=0)
crv_mullionpipes = Data(merge)
brep_mullionpipes = Data(pipe)

context_bake = ContextBake(CrvMullionPipes=crv_mullionpipes)
context_bake_2 = ContextBake(BrepMullionPipes=brep_mullionpipes)
